vi "Receive UDP Data.gvi"   [LabVIEW NXG 4.0.0]
# Reads an array of bytes from a UDP socket and writes that data onto the FPGA as PDSCH payload data.
# Only multiples of 4 bytes are written to the FPGA, because all the 32 bit written to the FPGA are intepreted as payload information. The remaining data is provided as an output and is stored in a shift register of the calling loop.
inputs:
  "session": "Host Session.gtype"
  "eNB TX active": bool  # A Boolean that indicates whether the eNodeB transmitter is active. Data is read from the UDP socket only if the transmitter is enabled.
  "UDP packet counter in": u32  # Counter value of the number of packets received, from the previous execution of this node.
  "error in": error
outputs:
  "FIFO full": bool  # A Boolean that indicates whether an overflow occurred of the host-to-target FIFO used for the data transfer to the FPGA.
  "data transfer": bool  # A Boolean that indicates whether data is received from the UDP socket. If this output is False, no data is provided to the FPGA, which fills the PUSCH payload with zeros instead.
  "UDP packet counter out": u32  # Counter value of the number of packets received, from the current execution of this node.
  "error out": error
  "num packets dropped": u32  # Counter value of the number of packets dropped.
types:
  "Transport Session.gtype" = cluster{"FIFO pathname": string, "pipe reader": "Pipe Reader.gtype", "pipe writer": "Pipe Writer.gtype", "transport in RT FIFO": RTFifoRefnum<u8[]>, "transport out RT FIFO": RTFifoRefnum<u8[]>, "transport in timing source name": string, "transport in timing trigger ID": u8, "transport out timing source name": string, "transport out timing trigger ID": u8, "maximum API message size": u32}
  "Register Bus Session.gtype" = Queue<"Session Data.gtype">
  "Semaphore.gtype" = i32
  "DB Queue Reference.gtype" = Queue<"Daughterboard Data.gtype">
  "niUsrpRio Session.gtype" = cluster{"FPGA Interface": any, "RIO Interface Number": u32, "Data Clock Rate": u32, "FPGA Data Clock Rate": u32, "Global Settings Register Bus": "Register Bus Session.gtype", "Radio 0 Settings Register Bus": "Register Bus Session.gtype", "Radio 1 Settings Register Bus": "Register Bus Session.gtype", "Radio Settings Bus Semaphore": "Semaphore.gtype", "DB Queues": "DB Queue Reference.gtype"[], "Characterization Data Valid?": bool, "EEPROM Header": "EEPROM Header.gtype", "Device Data Header": "EEPROM Device Data Header.gtype", "EEPROM Characterization Header": "EEPROM Characterization Header.gtype", "Characterization Data": "Characterization Data.gtype"[], "FPGA Current Version": u32, "FPGA Oldest Compatible Version": u32, "Fixed Logic Current Version": u32, "Fixed Logic Oldest Compatible Version": u32, "FPGA Radio Settings Bus Current Version": u32, "FPGA Radio Settings Bus Oldest Compatible Version": u32, "FPGA Board Config Current Version": u32, "FPGA Board Config Oldest Compatible Version": u32, "Daughterboard Clock Rate": u32}
  T1 = cluster{"FPGA ref": any, "bus instance": u32, "instruction FIFO depth": u32, "executing on FPGA target": bool, "show error call chain": bool}
  T2 = cluster{"Actual Gain [dB]": f64, "Attenuation Table Index": i32}
  T3 = cluster{"Attenuation Table [dB]": f64[][], "Frequencies [Hz]": f64[], "IQ Imbalance Table": "IQ Imbalance.gtype"[], "Gain Table": T2[][]}
  T4 = cluster{"FlexRIO Register Bus": Queue<T1>, "RX Characterization Data": T3, "TX Characterization Data": T3, "FPGA Interface": any}
  T5 = cluster{"transport block size": u32, "CRC ok": bool, "user data": u32}
  "Link Direction.gtype" = enum{"DL", "UL"}
  T6 = cluster{"MAC Stub RX Payload Information FIFO": RTFifoRefnum<"MAC Stub RX Payload Information.gtype">, "MAC Stub RX Confirmation Information FIFO": RTFifoRefnum<u64[16]>, "MAC Stub RX UL Payload Information FIFO": RTFifoRefnum<f64[23]>}
  T7 = cluster{"MAC Stub TX Input Terminals FIFO": RTFifoRefnum<"MAC Stub TX Input Terminals.gtype">, "MAC Stub TX Output Terminals FIFO": RTFifoRefnum<"MAC Stub TX Output Terminals.gtype">}
  T8 = cluster{"MAC Stub RX Interface": T6, "MAC Stub TX Interface": T7}
  "Host Session.gtype" = cluster{"target": enum{"USRP", "FlexRIO"}, "real time mode": bool, "MAC Stub enabled": bool, "DMA FIFO read timeout": i32, "timed loop period": i64, "LTE Transport Sessions": "Transport Session.gtype"[], "USRP session": "niUsrpRio Session.gtype", "FlexRIO session": T4, "UDP RX session": UdpNetworkConnectionRefnum, "UDP TX session": UdpNetworkConnectionRefnum, "sync found FIFO": RTFifoRefnum<bool>, "PDCCH CRC OK FIFO": RTFifoRefnum<bool>, "DL PDCCH status FIFO": RTFifoRefnum<cluster{"CRC ok": bool, "subframe number": u32}>, "DL PDSCH status FIFO": RTFifoRefnum<cluster{"CRC ok": bool, "subframe number": u32}>, "DL SINR FIFO": RTFifoRefnum<f64[]>, "PDSCH user data FIFO": RTFifoRefnum<u32>, "PDSCH user data UDP FIFO": RTFifoRefnum<T5>, "PDSCH user data throughput FIFO": RTFifoRefnum<T5>, "PUSCH user data FIFO": RTFifoRefnum<u32>, "PUSCH user data UDP FIFO": RTFifoRefnum<T5>, "PUSCH user data throughput FIFO": RTFifoRefnum<T5>, "UE feedback info FIFO": RTFifoRefnum<u8[]>, "Request information FIFO": RTFifoRefnum<"Request Information.gtype">, "UDP TX outbound FIFO": RTFifoRefnum<u8[]>, "UDP RX inbound FIFO": RTFifoRefnum<u8[]>, "stop notifier": Notifier<string>, "DL RX scope": string, "UL RX scope": string, "external MAC log file": string, "external MAC process ID": u32, "TX link direction": "Link Direction.gtype", "RX link direction": "Link Direction.gtype", "Sychronization FIFO": RTFifoRefnum<i32>, "RT Loop Interfaces": T8}
uses:
  AFW::Common::Data Transfer Protocol::DTP Header.gvi
  AFW::LTE::RF Control::Unbundle Session.gvi
  AFW::Common::Data Transfer Protocol::DTP Add Header and CRC.gvi
  NI::G Core::Error::Filter Error Code.gvi
diagram:
  w1 = 65535  # maximum UDP packet size
  case ($"eNB TX active") {
    frame False, Default {
      w2 = $"error in"
      w3 = FALSE
      w4 = FALSE
      w5 = $"UDP packet counter in"
      w6 = default
    }
    frame True {
      call "DTP Header.gvi"() -> (header length=w7)
      To Signed 32 Bit Integer(number=w7) -> w8
      Add(w1, w8) -> w9
      To Unsigned 32 Bit Integer(number=w9) -> w10
      call "Unbundle Session.gvi"(session=$session) -> (DL FPGA Interface=w11)
      Dynamic Fpga Interface Cast(reference in=w11, type=any constant) -> (reference out=w12)
      Host Fifo Write Node[FifoName="LTE AFW Resources.grsc::H2T PDSCH Payload"](data=u8[] [], error in=$"error in", reference in=w12, timeout (ms)=0) -> (empty elements remaining=w13, error out=w14, reference out=w15)
      Is Greater Or Equal(x=w13, y=w10) -> w16
      case (w16) {
        frame False, Default {
          w2 = w14
          w3 = FALSE
          w4 = TRUE
          w5 = $"UDP packet counter in"
          w6 = default
        }
        frame True {
          s1 = w14  # shift register
          s2 = $"UDP packet counter in"  # shift register
          while {
            Property Node(instance in=$session) -> ("UDP TX session"=w19)
            Udp Read Binary(connection ID=w19, error in=s1, max size=w1, timeout ms=10) -> (data out=w20, error out=w21)
            Is Empty Array(array=w20) -> w22
            case (w22) {
              frame False, Default {
                To Unsigned 16 Bit Integer(number=s2) -> w25
                call "DTP Add Header and CRC.gvi"(counter=w25, U8 input data array=w20) -> (U8 data array=w23)
                Increment(x=s2) -> w24
              }
              frame True {
                w23 = w20
                w24 = s2
              }
            }
            Host Fifo Write Node[FifoName="LTE AFW Resources.grsc::H2T PDSCH Payload"](data=w23, error in=w21, reference in=w15, timeout (ms)=0) -> (empty elements remaining=w26, error out=w27)
            call "Filter Error Code.gvi"(error in=w27, code to clear=113) -> (error out=w28, error cleared?=w29)
            Boolean To 0 Or 1(Boolean=w29) -> (0, 1=w30)
            To Unsigned 32 Bit Integer(number=w30) -> w31
            call "Filter Error Code.gvi"(error in=w28, code to clear=56) -> (error out=w32, error cleared?=w33)
            Not(x=w33) -> w3
            call "Filter Error Code.gvi"(error in=w32, code to clear=1) -> (error out=w34)
            call "Filter Error Code.gvi"(error in=w34, code to clear=66) -> (error out=w35)
            Is Less(x=w26, y=w10) -> w36
            Logical Or(w36, w22) -> w37
            append w29 to w17
            append w31 to w18
            next s1 = w35
            next s2 = w24
            stop if w37
          }
          Add Array Elements(numeric array=w18) -> (sum=w6)
          Or Array Elements(Boolean array=w17) -> (logical OR=w4)
          w2 = s1
          w5 = s2
        }
      }
    }
  }
  $"num packets dropped" <- w6
  $"FIFO full" <- w4
  $"data transfer" <- w3
  $"error out" <- w2
  $"UDP packet counter out" <- w5
