vi "LTE Calculate TX Power Spectrum MIMO.gvi"   [LabVIEW Communications System Design Suite 2.0.1]
# Reinterprets TX data values read from the FPGA and calculates the TX power spectrum.
inputs:
  "TX data": u32[]  # Array of transmitter data values read from the FPGA. Only the first 30,720 values are used for spectrum calculation.
  "error in": error
  "coerced gain [dB]": f64 = 10  # Coerced TX gain used for TX spectrum magnitude correction.
  "TX data AP1": u32[]  # Array of transmitter data values read from the FPGA. Only the first 30,720 values are used for spectrum calculation.
outputs:
  "TX power spectrum": T1  # Calculated TX power spectrum for 1 subframe (30,720 samples).
  "error out": error
  "TX power spectrum AP1": T1  # Calculated TX power spectrum for 1 subframe (30,720 samples).
types:
  T1 = cluster{"f0": f64, "df": f64, "magnitude": f64[]}
  T2 = enum{"No averaging", "Vector averaging", "RMS averaging", "Peak hold"}
  "Averaging Parameters.gtype" = cluster{"averaging mode": T2, "weighting mode": enum{"Linear", "Exponential"}, "number of averages": u32}
uses:
  NI::Analysis::Measurement::Power Spectrum for 1 Chan (CDB).gvi
diagram:
  Array Subset(array=$"TX data", length0=30720) -> w1
  Split Number(x=w1) -> (high(x)=w2, low(x)=w3)
  for {
    w4 = each element of w2
    w5 = each element of w3
    Reinterpret Number[RestrictToSameWordLength=True](data in=w4, type=UFXP(1.15) 0) -> (data out=w7)
    To Fixed Point(fixed-point type=FXP(1.15) 0, number=w7) -> w8: FXP(1.15) Wrap:Truncate
    To Double Precision Float(number=w8) -> w9
    Reinterpret Number[RestrictToSameWordLength=True](data in=w5, type=UFXP(1.15) 0) -> (data out=w10)
    To Fixed Point(fixed-point type=FXP(1.15) 0, number=w10) -> w11: FXP(1.15) Wrap:Truncate
    To Double Precision Float(number=w11) -> w12
    Real And Imaginary To Complex(x=w12, y=w9) -> w13
    append w13 to w6
  }
  Reciprocal(x=30720000) -> w14
  Property Node(instance in=waveform<c128> {dt=1, Y=[]}, "Y"=w6, "dt"=w14) -> (instance out=w15)
  call "Power Spectrum for 1 Chan (CDB).gvi"(signal=w15, window type="Rectangle"(0), averaging parameters="Averaging Parameters.gtype" {all zero or empty}, dB on=TRUE, error in=$"error in", restart averaging=FALSE) -> (power spectrum=w16, error out=w17)
  Property Node(instance in=w16) -> ("magnitude"=w18, instance out=w19)
  Add(w18, $"coerced gain [dB]") -> w20
  Property Node(instance in=w19, "magnitude"=w20) -> (instance out=w21)
  $"TX power spectrum" <- w21
  Array Subset(array=$"TX data AP1", length0=30720) -> w22
  Split Number(x=w22) -> (high(x)=w23, low(x)=w24)
  for {
    w25 = each element of w23
    w26 = each element of w24
    Reinterpret Number[RestrictToSameWordLength=True](data in=w25, type=UFXP(1.15) 0) -> (data out=w28)
    To Fixed Point(fixed-point type=FXP(1.15) 0, number=w28) -> w29: FXP(1.15) Wrap:Truncate
    To Double Precision Float(number=w29) -> w30
    Reinterpret Number[RestrictToSameWordLength=True](data in=w26, type=UFXP(1.15) 0) -> (data out=w31)
    To Fixed Point(fixed-point type=FXP(1.15) 0, number=w31) -> w32: FXP(1.15) Wrap:Truncate
    To Double Precision Float(number=w32) -> w33
    Real And Imaginary To Complex(x=w33, y=w30) -> w34
    append w34 to w27
  }
  Reciprocal(x=30720000) -> w35
  Property Node(instance in=waveform<c128> {dt=1, Y=[]}, "Y"=w27, "dt"=w35) -> (instance out=w36)
  call "Power Spectrum for 1 Chan (CDB).gvi"(signal=w36, window type="Rectangle"(0), averaging parameters="Averaging Parameters.gtype" {all zero or empty}, dB on=TRUE, error in=$"error in", restart averaging=FALSE) -> (power spectrum=w37, error out=w38)
  Property Node(instance in=w37) -> ("magnitude"=w39, instance out=w40)
  Add(w39, $"coerced gain [dB]") -> w41
  Property Node(instance in=w40, "magnitude"=w41) -> (instance out=w42)
  $"TX power spectrum AP1" <- w42
  Merge Errors(w17, w38) -> (error out=w43)
  $"error out" <- w43
