vi "Generate Waveform (Multi-Array).gvi"   [LabVIEW NXG 4.0.0]
inputs:
  "tx config in": T2 = {"rf enable 0"=FALSE, "rf config 0"={"antenna"="TX1", "frequency"=2000000000, "lo frequency"=-1, "level"=0}, "rf enable 1"=FALSE, "rf config 1"={"antenna"="TX1", "frequency"=2000000000, "lo frequency"=-1, "level"=0}, "transfer mode"="Finite", "sample rate"=10000000, "number of samples"=8192, "start trigger"="Immediate", "tone frequency"=100000}
outputs:
  "tx config out": T2
  "I_Comb": i16[][]
  "Q_Comb": i16[][]
  "waveform": waveform<f64>[]
  "Sample Number": u32
  "Fs": f64
types:
  T1 = cluster{"antenna": string, "frequency": f64, "lo frequency": f64, "level": f64}
  "Start Trigger.gtype" = enum{"Software", "Digital Edge", "Rx Start Trigger", "Tx Start Trigger", "Immediate", "Future Time Event"}
  T2 = cluster{"rf enable 0": bool, "rf config 0": T1, "rf enable 1": bool, "rf config 1": T1, "transfer mode": enum{"Finite", "Continuous"}, "sample rate": f64, "number of samples": u32, "start trigger": "Start Trigger.gtype", "tone frequency": f64}
uses:
  Host SubVIs::test.mli::Test
diagram:
  call "Test"() -> (output=w1, Fs=w2)
  Property Node(instance in=$"tx config in") -> (instance out=w3)
  Array Size(array=w1) -> (size(s)=w4)
  Array Index(array=w4) -> (out0[0]=w5)
  To Unsigned 32 Bit Integer(number=w5) -> w6
  Property Node(instance in=w3, "number of samples"=w6, "sample rate"=w2) -> (instance out=w7)
  $"tx config out" <- w7
  $"Sample Number" <- w6
  $Fs <- w2
  # Sampling Time
  Reciprocal(x=w2) -> w8
  Array Index(array=w1) -> (out0[_, 3]=w9)
  Complex To Real And Imaginary(x + iy=w9) -> (x=w10, y=w11)
  Build Waveform Node(Y=w11, dt=w8) -> (output waveform=w12)
  Property Node(instance in=w12) -> ("Y"=w13, instance out=w14)
  Build Waveform Node(Y=w10, dt=w8) -> (output waveform=w15)
  Property Node(instance in=w15) -> ("Y"=w16, instance out=w17)
  # Sampling Time
  Reciprocal(x=w2) -> w18
  Array Index(array=w1) -> (out0[_, 2]=w19)
  Complex To Real And Imaginary(x + iy=w19) -> (x=w20, y=w21)
  Build Waveform Node(Y=w21, dt=w18) -> (output waveform=w22)
  Property Node(instance in=w22) -> ("Y"=w23, instance out=w24)
  Build Waveform Node(Y=w20, dt=w18) -> (output waveform=w25)
  Property Node(instance in=w25) -> ("Y"=w26, instance out=w27)
  # Sampling Time
  Reciprocal(x=w2) -> w28
  Array Index(array=w1) -> (out0[_, 1]=w29)
  Complex To Real And Imaginary(x + iy=w29) -> (x=w30, y=w31)
  Build Waveform Node(Y=w31, dt=w28) -> (output waveform=w32)
  Build Waveform Node(Y=w30, dt=w28) -> (output waveform=w33)
  # Sampling Time
  Reciprocal(x=w2) -> w34
  Array Index(array=w1) -> (out0[_, 0]=w35)
  Complex To Real And Imaginary(x + iy=w35) -> (x=w36, y=w37)
  Build Waveform Node(Y=w36, dt=w34) -> (output waveform=w38)
  Build Waveform Node(Y=w37, dt=w34) -> (output waveform=w39)
  Build Array(w38, w39) -> w40
  Build Array(w40, w33) -> w41
  Build Array(w41, w32) -> w42
  Build Array(w42, w27) -> w43
  Build Array(w43, w24) -> w44
  Build Array(w44, w17) -> w45
  Build Array(w45, w14) -> w46
  $waveform <- w46
  Property Node(instance in=w38) -> ("Y"=w47)
  Multiply(w47, 32767) -> w48
  To Signed 16 Bit Integer(number=w48) -> w49
  Property Node(instance in=w33) -> ("Y"=w50)
  Multiply(w50, 32767) -> w51
  To Signed 16 Bit Integer(number=w51) -> w52
  Build Array(w49, w52) -> w53
  Multiply(w26, 32767) -> w54
  To Signed 16 Bit Integer(number=w54) -> w55
  Multiply(w16, 32767) -> w56
  To Signed 16 Bit Integer(number=w56) -> w57
  Build Array(w55, w57) -> w58
  Build Array(w53, w58) -> w59
  $I_Comb <- w59
  Property Node(instance in=w39) -> ("Y"=w60)
  Multiply(w60, 32767) -> w61
  To Signed 16 Bit Integer(number=w61) -> w62
  Property Node(instance in=w32) -> ("Y"=w63)
  Multiply(w63, 32767) -> w64
  To Signed 16 Bit Integer(number=w64) -> w65
  Build Array(w62, w65) -> w66
  Multiply(w23, 32767) -> w67
  To Signed 16 Bit Integer(number=w67) -> w68
  Multiply(w13, 32767) -> w69
  To Signed 16 Bit Integer(number=w69) -> w70
  Build Array(w68, w70) -> w71
  Build Array(w66, w71) -> w72
  $Q_Comb <- w72
