vi "Configure Rx.gvi"   [LabVIEW NXG 4.0.0]
inputs:
  "niUsrpRio Session": "niUsrpRio Session.gtype", required
  "rx config": T2 = {"rf enable 0"=FALSE, "rf config 0"={"antenna"="RX2", "frequency"=2000000000, "lo frequency"=-1, "level"=0}, "rf enable 1"=FALSE, "rf config 1"={"antenna"="RX2", "frequency"=2000000000, "lo frequency"=-1, "level"=0}, "transfer mode"="Finite", "sample rate"=10000000, "number of samples"=8192, "start trigger"="Immediate"}, required
  "error in": error
outputs:
  "niUsrpRio Session (out)": "niUsrpRio Session.gtype"
  "rx.enabled channels": string[]
  "vertical range": f64[]
  "error out": error
  "rx.coerced configurations": T3
types:
  "Register Bus Session.gtype" = Queue<"Session Data.gtype">
  "Semaphore.gtype" = i32
  "DB Queue Reference.gtype" = Queue<"Daughterboard Data.gtype">
  "EEPROM Header.gtype" = cluster{"Checksum": u32, "Product Code": u16, "Hardware Current Version": u16, "Hardware Oldest Compatible Version": u16, "EEPROM Map Current Version": u16, "EEPROM Map Oldest Compatible Version": u16, "User Password": string, "Pointer to Factory Header": u32, "Pointer to User Header": u32, "Recommended Interval": u16, "Number of Reserved Bytes": i32, "Number of Daughterboards": u8, "Daughterboard IDs": u16[], "Daughterboard Serial Numbers": string[]}
  "EEPROM Device Data Header.gtype" = cluster{"Checksum": u32, "Number of Channels": u8, "Number of Gain Settings": u16[], "Pointer to Characterization Data": u32[], "Number of Reserved Bytes": i32, "Number of Frequencies": u16[]}
  "EEPROM Characterization Header.gtype" = cluster{"Checksum": u32, "Date": timestamp, "Temperature": f32, "Misc. Info": string, "Pointer to Device Data Header": u32, "Number of Reserved Bytes": i32}
  "Characterization Data.gtype" = cluster{"Gains[dB]": f64[], "Frequencies [Hz]": f64[], "IQ Imbalance Table": "IQ Imbalance.gtype"[], "Measured Gains[dB]": f64[][]}
  "niUsrpRio Session.gtype" = cluster{"FPGA Interface": any, "RIO Interface Number": u32, "Data Clock Rate": u32, "FPGA Data Clock Rate": u32, "Global Settings Register Bus": "Register Bus Session.gtype", "Radio 0 Settings Register Bus": "Register Bus Session.gtype", "Radio 1 Settings Register Bus": "Register Bus Session.gtype", "Radio Settings Bus Semaphore": "Semaphore.gtype", "DB Queues": "DB Queue Reference.gtype"[], "Characterization Data Valid?": bool, "EEPROM Header": "EEPROM Header.gtype", "Device Data Header": "EEPROM Device Data Header.gtype", "EEPROM Characterization Header": "EEPROM Characterization Header.gtype", "Characterization Data": "Characterization Data.gtype"[], "FPGA Current Version": u32, "FPGA Oldest Compatible Version": u32, "Fixed Logic Current Version": u32, "Fixed Logic Oldest Compatible Version": u32, "FPGA Radio Settings Bus Current Version": u32, "FPGA Radio Settings Bus Oldest Compatible Version": u32, "FPGA Board Config Current Version": u32, "FPGA Board Config Oldest Compatible Version": u32, "Daughterboard Clock Rate": u32}
  T1 = cluster{"antenna": string, "frequency": f64, "lo frequency": f64, "level": f64}
  "Start Trigger.gtype" = enum{"Software", "Digital Edge", "Rx Start Trigger", "Tx Start Trigger", "Immediate", "Future Time Event"}
  T2 = cluster{"rf enable 0": bool, "rf config 0": T1, "rf enable 1": bool, "rf config 1": T1, "transfer mode": enum{"Finite", "Continuous"}, "sample rate": f64, "number of samples": u32, "start trigger": "Start Trigger.gtype"}
  T3 = cluster{"coerced frequencies": f64[], "coerced lo frequencies": f64[], "coerced levels": f64[], "coerced sample rates": f64[]}
uses:
  Host SubVIs::Construct Channels.gvi
  Host SubVIs::Configure Signal (Level).gvi
  Host SubVIs::Configure Start Trigger.gvi
  Host SubVIs::Configure Stream.gvi
diagram:
  Property Node(instance in=$"rx config") -> ("rf enable 0"=w1, "rf config 0"=w2, "rf enable 1"=w3, "rf config 1"=w4, "transfer mode"=w5, "sample rate"=w6, "number of samples"=w7, "start trigger"=w8)
  w9 = cluster{"rf enable 0": bool, "rf config 0": T1} {all zero or empty}
  Property Node(instance in=w9, "rf enable 0"=w1, "rf config 0"=w2) -> (instance out=w10)
  w11 = cluster{"rf enable 1": bool, "rf config 1": T1} {all zero or empty}
  Property Node(instance in=w11, "rf enable 1"=w3, "rf config 1"=w4) -> (instance out=w12)
  Build Array(w10, w12) -> w13
  call "Construct Channels.gvi"(channel configurations=w13, scope="rx") -> (enabled channels=w14, enabled channel configurations=w15)
  Array Size(array=w14) -> (size(s)=w16)
  case (w16) {
    frame 0 {
      w17 = default
      w18 = default
      w19 = default
      w20 = default
      w21 = $"niUsrpRio Session"
      w22 = $"error in"
      w23 = default
      w24 = default
    }
    frame Default {
      s1 = $"error in"  # shift register
      for {
        w25 = each element of w14
        w26 = each element of w15
        Property Node(instance in=w26) -> ("frequency"=w27, "level"=w28, "antenna"=w29, "lo frequency"=w30)
        call "Configure Signal (Level).gvi"(active antenna=w29, lo frequency [hz]=w30, niusrprio session in=$"niUsrpRio Session", sample rate [s/s]=w6, frequency [hz]=w27, level [dbm]=w28, error in=s1, scope=w25) -> (coerced lo frequency [hz]=w31, niusrprio session out=w32, coerced sample rate [s/s]=w33, coerced frequency [hz]=w34, coerced level [dbm]=w35, error out=w36, coerced vertical range [vpp]=w37)
        call "Configure Start Trigger.gvi"(niusrprio session in=w32, start trigger=w8, error in=w36, scope=w25) -> (niusrprio session out=w38, error out=w39)
        Is Equal To 0(x=w5) -> w40
        call "Configure Stream.gvi"(niusrprio session in=w38, number of samples is finite=w40, number of samples=w7, error in=w39, scope=w25) -> (niusrprio session out=w21, error out=w41)
        append w37 to w23
        append w33 to w17
        append w34 to w18
        append w35 to w19
        append w31 to w20
        append w25 to w24
        next s1 = w41
      }
      w22 = s1
    }
  }
  $"vertical range" <- w23
  $"rx.enabled channels" <- w24
  $"niUsrpRio Session (out)" <- w21
  $"error out" <- w22
  Property Node(instance in=T3 {all zero or empty}, "coerced sample rates"=w17, "coerced frequencies"=w18, "coerced levels"=w19, "coerced lo frequencies"=w20) -> (instance out=w42)
  $"rx.coerced configurations" <- w42
