vi "Generate Waveform (Multi-Array).gvi"   [LabVIEW NXG 4.0.0]
inputs:
  "tx config in": T2 = {"rf enable 0"=FALSE, "rf config 0"={"antenna"="TX1", "frequency"=2000000000, "lo frequency"=-1, "level"=0}, "rf enable 1"=FALSE, "rf config 1"={"antenna"="TX1", "frequency"=2000000000, "lo frequency"=-1, "level"=0}, "transfer mode"="Finite", "sample rate"=10000000, "number of samples"=8192, "start trigger"="Immediate", "tone frequency"=100000}
  "number of samples": u32 = 300000
  "sample rate": f64 = 10000000
  "tone frequency": f64 = 130000
  "amplitude": f64 = 1
outputs:
  "Sample Number": u32
  "I_Comb": i16[][]
  "Q_Comb": i16[][]
  "waveform": waveform<f64>[]
  "error out": error
  "Fs": f64
  "tx config out": T2
panel indicators:
  "i_2": i16[]
  "q_2": i16[]
  "i": i16[]
  "q": i16[]
types:
  T1 = cluster{"antenna": string, "frequency": f64, "lo frequency": f64, "level": f64}
  "Start Trigger.gtype" = enum{"Software", "Digital Edge", "Rx Start Trigger", "Tx Start Trigger", "Immediate", "Future Time Event"}
  T2 = cluster{"rf enable 0": bool, "rf config 0": T1, "rf enable 1": bool, "rf config 1": T1, "transfer mode": enum{"Finite", "Continuous"}, "sample rate": f64, "number of samples": u32, "start trigger": "Start Trigger.gtype", "tone frequency": f64}
uses:
  Host SubVIs::GenLTEFrame1TxAnt.mli::GetLTEFrame1TxAnt
  NI::G Core::File IO (General)::Write Delimited Spreadsheet (Waveform Array).gvi
  NI::Analysis::Generation::Sine Waveform.gvi
diagram:
  call "GetLTEFrame1TxAnt"() -> (ComplexSamples=w1, Fs=w2)
  Property Node(instance in=$"tx config in") -> (instance out=w3)
  Array Size(array=w1) -> (size(s)=w4)
  Array Index(array=w4) -> (out0[0]=w5)
  To Unsigned 32 Bit Integer(number=w5) -> w6
  Property Node(instance in=w3, "number of samples"=w6, "sample rate"=w2) -> (instance out=w7)
  $"tx config out" <- w7
  $"Sample Number" <- w6
  $Fs <- w2
  # Sampling Time
  Reciprocal(x=w2) -> w8
  Array Index(array=w1) -> (out0[_, 0]=w9)
  Complex To Real And Imaginary(x + iy=w9) -> (x=w10, y=w11)
  Build Waveform Node(Y=w10, dt=w8) -> (output waveform=w12)
  Build Waveform Node(Y=w11, dt=w8) -> (output waveform=w13)
  Build Array(w12, w13) -> w14
  call "Write Delimited Spreadsheet (Waveform Array).gvi"(delimiter=";", file=path "C:\\Users\\ge69mog\\Documents\\WaveformLTEFrame.csv", waveforms=w14)
  $waveform <- w14
  Property Node(instance in=w12) -> ("Y"=w15)
  Multiply(w15, 32767) -> w16
  To Signed 16 Bit Integer(number=w16) -> w17
  $i <- w17
  # Sampling Time
  Reciprocal(x=w2) -> w18
  Array Index(array=w1) -> (out0[_, 1]=w19)
  Complex To Real And Imaginary(x + iy=w19) -> (x=w20, y=w21)
  Build Waveform Node(Y=w20, dt=w18) -> (output waveform=w22)
  Property Node(instance in=w22) -> ("Y"=w23)
  Multiply(w23, 32767) -> w24
  To Signed 16 Bit Integer(number=w24) -> w25
  Build Array(w17, w25) -> w26
  $I_Comb <- w26
  Property Node(instance in=w13) -> ("Y"=w27)
  Multiply(w27, 32767) -> w28
  To Signed 16 Bit Integer(number=w28) -> w29
  $q <- w29
  $i_2 <- w25
  Build Waveform Node(Y=w21, dt=w18) -> (output waveform=w30)
  Property Node(instance in=w30) -> ("Y"=w31)
  Multiply(w31, 32767) -> w32
  To Signed 16 Bit Integer(number=w32) -> w33
  Build Array(w29, w33) -> w34
  $Q_Comb <- w34
  $q_2 <- w33
  call "Sine Waveform.gvi"(sample rate=$"sample rate", samples=$"number of samples", amplitude=$amplitude, frequency=$"tone frequency", phase in=90) -> (error out=w35)
  call "Sine Waveform.gvi"(sample rate=$"sample rate", samples=$"number of samples", amplitude=$amplitude, frequency=$"tone frequency", phase in=0) -> (error out=w36)
  Merge Errors(w35, w36) -> (error out=w37)
  $"error out" <- w37
