vi "Tx and Rx Streaming (Host).gvi"   [LabVIEW NXG 4.0.0]
# This template is for the Simple NI-USRP Streaming design, a design that shows the basics of streaming data to and from an NI USRP-294x/295x device. Refer to the block diagram for more information about how to use this template.
panel controls:
  "USRP RIO device": string = "RIO0"
  "Reference Frequency Source": string = "Internal"
  "tx.stop": bool
  "rx.stop": bool
  "Tab_2": i32
  "tx config": T4 = {"rf enable 0"=TRUE, "rf config 0"={"Antenna RF 0"="TX1", "Frequency RF 0 [Hz]"=2000000000, "LO Frequency RF 0 [Hz]"=-1, "Output Power RF 0 [dBm]"=0}, "rf enable 1"=TRUE, "rf config 1"={"Antenna RF 1"="TX1", "Frequency RF 1 [Hz]"=2000000000, "LO Frequency RF 1 [Hz]"=-1, "Output Power RF 1 [dBm]"=0}, "Generation Mode"="Finite", "Sample Rate [S/s]"=10000000, "Number of Samples"=8192, "Start Trigger"="Immediate", "Tone Frequency [Hz]"=100000}
  "rx config": T7 = {"rf enable 0"=TRUE, "rf config 0"={"Antenna RF 0"="RX2", "Frequency RF 0 [Hz]"=2000000000, "LO Frequency RF 0 [Hz]"=-1, "Reference Level RF 0 [dBm]"=0}, "rf enable 1"=TRUE, "rf config 1"={"Antenna RF 1"="RX2", "Frequency RF 1 [Hz]"=2000000000, "LO Frequency RF 1 [Hz]"=-1, "Reference Level RF 1 [dBm]"=0}, "Acquisition Mode"="Finite", "Sample Rate [S/s]"=10000000, "Number of Samples"=8192, "Start Trigger"="Immediate"}
  "Tab": i32
panel indicators:
  "Acquiring": bool
  "Generating": bool
  "Output Waveform": waveform<f64>[]
  "TX Coerced Configurations": T8
  "RX Coerced Configurations": T9
  "Power Spectrum": T10[]
  "Power Level": f64[][]
  "I & Q Data": f64[][]
  "Numeric": u32
types:
  T1 = cluster{"Antenna RF 0": string, "Frequency RF 0 [Hz]": f64, "LO Frequency RF 0 [Hz]": f64, "Output Power RF 0 [dBm]": f64}
  T2 = cluster{"Antenna RF 1": string, "Frequency RF 1 [Hz]": f64, "LO Frequency RF 1 [Hz]": f64, "Output Power RF 1 [dBm]": f64}
  T3 = enum{"Software", "Digital Edge", "Rx Start Trigger", "Tx Start Trigger", "Immediate", "Future Time Event"}
  T4 = cluster{"rf enable 0": bool, "rf config 0": T1, "rf enable 1": bool, "rf config 1": T2, "Generation Mode": enum{"Finite", "Continuous"}, "Sample Rate [S/s]": f64, "Number of Samples": u32, "Start Trigger": T3, "Tone Frequency [Hz]": f64}
  T5 = cluster{"Antenna RF 0": string, "Frequency RF 0 [Hz]": f64, "LO Frequency RF 0 [Hz]": f64, "Reference Level RF 0 [dBm]": f64}
  T6 = cluster{"Antenna RF 1": string, "Frequency RF 1 [Hz]": f64, "LO Frequency RF 1 [Hz]": f64, "Reference Level RF 1 [dBm]": f64}
  T7 = cluster{"rf enable 0": bool, "rf config 0": T5, "rf enable 1": bool, "rf config 1": T6, "Acquisition Mode": enum{"Finite", "Continuous"}, "Sample Rate [S/s]": f64, "Number of Samples": u32, "Start Trigger": T3}
  T8 = cluster{"Coerced Frequencies [Hz]": f64[], "Coerced LO Frequencies [Hz]": f64[], "Coerced Output Powers [dBm]": f64[], "Coerced Sample Rates [S/s]": f64[]}
  T9 = cluster{"Coerced Frequencies [Hz]": f64[], "Coerced LO Frequencies [Hz]": f64[], "Coerced Levels [dBm]": f64[], "Coerced Sample Rates [S/s]": f64[]}
  T10 = cluster{"f0": f64, "df": f64, "magnitude": f64[]}
uses:
  Host SubVIs::Open and Configure Device.gvi
  NI::G Core::Timing::Elapsed Timer.gvi
  Host SubVIs::Initiate and Fetch (Single).gvi
  Host SubVIs::Calculate Power.gvi
  Host SubVIs::Initiate and Generate (Single).gvi
  Host SubVIs::Close Device.gvi
  NI::G Core::Error::Display Error.gvi
diagram:
  # 1. Open and configure device
  # 2a. Receive data
  # 2b. Transmit data
  # 3. Close device
  # 1.
  call "Open and Configure Device.gvi"(rx config=$"rx config", tx config=$"tx config", USRP RIO Device=$"USRP RIO device", reference frequency source=$"Reference Frequency Source") -> (niUsrpRio Session (out)=w1, rx.coerced configurations=w2, tx.coerced configurations=w3, tx.output waveform=w4, error out=w5, rx channels=w6, tx channels=w7)
  # 3.
  s1 = w5  # shift register
  while (iteration -> i1) {
    call "Elapsed Timer.gvi"(target time=0.05) -> (time has elapsed=w8)
    Is Equal To 0(x=i1) -> w9
    call "Initiate and Fetch (Single).gvi"(niUsrpRio Session=w1, first iteration=w9, error in=s1, rx channels=w6) -> (niUsrpRio Session (out)=w10, complex baseband data=w11, error out=w12)
    call "Elapsed Timer.gvi"(target time=1) -> (time has elapsed=w13)
    # 2a.
    case (w8) {
      frame False, Default { }
      frame True {
        Array Index(array=w11) -> (out0[0]=w14)
        Property Node(instance in=w14)
        Array Index(array=w11)
        Feedback Node(input=w15) -> w16
        case (w13) {
          frame True {
            $Numeric <- w16
          }
          frame False { }
        }
        Feedback Node(initial value=0, input=w15) -> w17
        case (w13) {
          frame True {
            w18 = 0
          }
          frame False {
            w18 = w17
          }
        }
        Increment(x=w18) -> w15
        call "Calculate Power.gvi"(waveform=w11) -> (Power Spectrum=w19, Power Level=w20, I & Q Data=w21)
        $"Power Spectrum" <- w19
        $"Power Level" <- w20
        $"I & Q Data" <- w21
      }
    }
    Logical Or(w12, $"rx.stop") -> w22
    Not(x=w22) -> w23
    $Acquiring <- w23
    next s1 = w12
    stop if w22
  }
  s2 = w5  # shift register
  while (iteration -> i2) {
    Is Equal To 0(x=i2) -> w24
    # 2b.
    call "Initiate and Generate (Single).gvi"(niUsrpRio Session=w1, first iteration=w24, error in=s2, tx channels=w7) -> (error out=w25)
    Logical Or(w25, $"tx.stop") -> w26
    Not(x=w26) -> w27
    $Generating <- w27
    next s2 = w25
    stop if w26
  }
  Merge Errors(s1, s2) -> (error out=w28)
  call "Close Device.gvi"(niusrprio session in=w10, error in=w28) -> (error out=w29)
  call "Display Error.gvi"(error in=w29, type of dialog="OK message + warnings")
  $"RX Coerced Configurations" <- w2
  $"TX Coerced Configurations" <- w3
  $"Output Waveform" <- w4
